# Grasshopper definition 01-invisibledragon-envelope-profile.gh (Grasshopper 1.0.7)
# plug-ins: InvisibleDragon

exterior_concrete = Panel("Exterior Concrete")
mineral_wool = Panel("Mineral Wool")
interior_finish = Panel("Interior Finish")
mat = OpaqueMaterial(Name=exterior_concrete, Conductivity=0.5, Density=800, SpecificHeat=1000)
mat_2 = OpaqueMaterial(Name=mineral_wool, Conductivity=0.5, Density=800, SpecificHeat=1000)
mat_3 = OpaqueMaterial(Name=interior_finish, Conductivity=0.5, Density=800, SpecificHeat=1000)
concrete_0_200_m = Slider(0.2, range=0.01..0.5)
insulation_0_120_m = Slider(0.12, range=0.01..0.5)
finish_0_013_m = Slider(0.013, range=0.001..0.1)
layer = ConstructionLayer(Material=mat, Thickness=concrete_0_200_m)
layer_2 = ConstructionLayer(Material=mat_2, Thickness=insulation_0_120_m)
layer_3 = ConstructionLayer(Material=mat_3, Thickness=finish_0_013_m)
con = LayeredConstruction(Name="Layered Construction", Layers=[layer, layer_2, layer_3])  # -> Construction, UValue
nomass = NoMassConstruction(Name="No-Mass Construction", UValue=0.35)
prof = ConstantProfile(Name="Basic Profile", HeatingSetpoint=20, CoolingSetpoint=26, Occupancy=0)  # -> Profile, Diagnostics
layered_u_value = Panel(con.UValue)
layered_construction = Panel(con.Construction)
no_mass_construction = Panel(nomass)
annual_profile = Panel(prof.Profile)
