# Grasshopper definition 02-invisibledragon-single-zone-hvac-idf.gh (Grasshopper 1.0.7)
# plug-ins: InvisibleDragon

# ---- group: 3 Zone systems
# Plant components feed terminal systems; terminal and ERV
# outputs connect directly to the zone.
heatpump = HeatPump(Name="Heat Pump", Fuel="Electricity", HeatingCOP=3.5, CoolingCOP=4, HeatingCapacity=0, CoolingCapacity=0)
boiler = Boiler(Name="Boiler", Fuel="NaturalGas", ThermalEfficiency=0.9, NominalCapacity=0, PumpMotorEfficiency=0.9, HotWaterSetpoint=60)
erv_supply_flow_0_20_m3_s = Slider(0.2, range=0.01..2)
ahu = AirHandlingUnit(Name="Air Handling Unit", HeatPump=heatpump, FanTotalEfficiency=0.7, FanPressureRise=100, MotorEfficiency=0.9)
erv = EnergyRecoveryVentilator(
    Name="Energy Recovery Ventilator",
    SensibleEffectiveness=0.75,
    LatentEffectiveness=0.65,
    SupplyAirFlow=erv_supply_flow_0_20_m3_s,
    FanTotalEfficiency=0.7,
    FanPressureRise=100)
radiantfloor = RadiantFloor(Name="Radiant Floor", HydronicSource=boiler, ThrottlingRange=2)

# ---- group: 1 Envelope construction
# Build one reusable opaque construction before authoring the
# zone envelope.
mat = OpaqueMaterial(Name="Opaque Material", Conductivity=0.5, Density=800, SpecificHeat=1000)
envelope_0_200_m = Slider(0.2, range=0.01..0.5)
layer = ConstructionLayer(Material=mat, Thickness=envelope_0_200_m)
con = LayeredConstruction(Name="Layered Construction", Layers=layer)  # -> Construction, UValue

# ---- group: 2 Zone envelope, opening and profile
# Floor, ceiling and wall lists own their geometry; the south
# wall also owns its window.
south_window_boundary = Curve(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)
south_wall_boundary = Curve(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)
ceiling_boundary = Curve(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)
floor_boundary = Curve(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)
plain_walls_list = Curve([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])
plain_wall_names_list = Text(["North Wall", "West Wall", "East Wall"])
glass = Glazing(Name="Glazing", UValue=1.5, SHGC=0.5)
floor_name = Panel("Floor")
ceiling_name = Panel("Roof")
south_wall_name = Panel("South Wall")
prof = ConstantProfile(Name="Basic Profile", HeatingSetpoint=20, CoolingSetpoint=26, Occupancy=0)  # -> Profile, Diagnostics
floor_boundary_2 = ValueList({"Outdoors", "Ground", "Adiabatic"}, selected="Ground")
window = WindowFromPolyline(Curve=south_window_boundary, Name="Window", Glazing=glass)
floor = Floor(Curve=floor_boundary, Name=floor_name, Construction=con.Construction, BoundaryCondition=floor_boundary_2)  # -> Surface, GrossArea, NetArea, Valid, Diagnostics
ceiling = Ceiling(Curve=ceiling_boundary, Name=ceiling_name, Construction=con.Construction, BoundaryCondition="Outdoors")  # -> Surface, GrossArea, NetArea, Valid, Diagnostics
wall = Wall(Curve=plain_walls_list, Name=plain_wall_names_list, Construction=con.Construction, BoundaryCondition="Outdoors")  # -> Surface, GrossArea, NetArea, Valid, Diagnostics
wall_2 = Wall(
    Curve=south_wall_boundary,
    Name=south_wall_name,
    Construction=con.Construction,
    BoundaryCondition="Outdoors",
    Openings=window)  # -> Surface, GrossArea, NetArea, Valid, Diagnostics

# ---- group: 4 Zone and energy model
# The completed zone and optional photovoltaic system form the
# energy model.
zone = ThermalZone(
    Name="Zone",
    Surfaces=[floor.Surface, ceiling.Surface, wall.Surface, wall_2.Surface],
    Profile=prof.Profile,
    Infiltration=0,
    LightingPowerDensity=0,
    OutdoorAirFlow=0,
    HVAC=[ahu, radiantfloor],
    ERVs=erv)  # -> Zone, Valid, Diagnostics
pv = PhotovoltaicPanel(Name="Photovoltaic Panel", Area=10, Tilt=30, Azimuth=180, Efficiency=0.2, ActiveCellAreaFraction=0.7)
model = EnergyModel(Name="InvisibleDragon Model", Zones=zone.Zone, NorthAxis=0, Terrain="Suburbs", PVPanels=pv)  # -> Model, Valid, Diagnostics

# ---- group: 5 Managed IDF compile
# Compile the model internally to an IDF and inspect validation
# before running.
id_to_idf = CompileInvisibleDragon(Model=model.Model)  # -> IDF, Text, Valid, Diagnostics
compiled_idf = Panel(id_to_idf.Text)
managed_idf_validation = Panel(id_to_idf.Valid)
compilation_diagnostics = Panel(id_to_idf.Diagnostics)

# ---- group: 6 Weather
# InvisibleDragon accepts the user-selected EPW and verifies it
# before simulation.
epw_file = FilePath()
id_weather = VerifyInvisibleDragonWeather(EPWFile=epw_file)  # -> Weather, Success, Diagnostics
weather_verified = Panel(id_weather.Success)
weather_diagnostics = Panel(id_weather.Diagnostics)

# ---- group: 7 Managed EnergyPlus run
# Set Run to True for a rising edge. Cancel, force-rerun and
# timeout remain optional controls.
run_explicit_rising_edge = Boolean(False)
cancel_active_run = Boolean(False)
force_rerun = Boolean(False)
run_timeout_30_min = Slider(30, range=1..120)
run = RunInvisibleDragon(
    IDF=id_to_idf.IDF,
    Weather=id_weather.Weather,
    Run=run_explicit_rising_edge,
    Cancel=cancel_active_run,
    ForceRerun=force_rerun,
    Timeout=run_timeout_30_min)  # -> Result, State, Success, Diagnostics
energyplus_result = Panel(run.Result)
invisibledragon_run_state = Panel(run.State)
invisibledragon_run_success = Panel(run.Success)
run_diagnostics = Panel(run.Diagnostics)
