# Grasshopper definition 10-simpledragon-material-construction.gh (Grasshopper 1.0.7)
# plug-ins: SimpleDragon

sd_material = SimpleDragonMaterial(Name="Simple Material", Conductivity=0.04, Density=30, SpecificHeat=1400)
thickness_m = Slider(0.1, range=0.01..1)
sd_layer = SimpleDragonConstructionLayer(Material=sd_material, Thickness=thickness_m)
sd_construction = SimpleDragonSurfaceConstruction(Name="Simple Construction", Layers=sd_layer)  # -> Construction, UValue
u_value = Panel(sd_construction.UValue)
