# Grasshopper definition 11-simpledragon-envelope-hvac.gh (Grasshopper 1.0.7)
# plug-ins: SimpleDragon

exterior_concrete_name = Panel("Exterior Concrete")
sd_material = SimpleDragonMaterial(Name=exterior_concrete_name, Conductivity=0.04, Density=30, SpecificHeat=1400)
exterior_concrete_thickness = Slider(0.2, range=0.001..0.5)
mineral_wool_name = Panel("Mineral Wool")
sd_material_2 = SimpleDragonMaterial(Name=mineral_wool_name, Conductivity=0.04, Density=30, SpecificHeat=1400)
mineral_wool_thickness = Slider(0.12, range=0.001..0.5)
gypsum_board_name = Panel("Gypsum Board")
sd_material_3 = SimpleDragonMaterial(Name=gypsum_board_name, Conductivity=0.04, Density=30, SpecificHeat=1400)
gypsum_board_thickness = Slider(0.013, range=0.001..0.5)
sd_layer = SimpleDragonConstructionLayer(Material=sd_material, Thickness=exterior_concrete_thickness)
sd_layer_2 = SimpleDragonConstructionLayer(Material=sd_material_2, Thickness=mineral_wool_thickness)
sd_layer_3 = SimpleDragonConstructionLayer(Material=sd_material_3, Thickness=gypsum_board_thickness)
sd_construction = SimpleDragonSurfaceConstruction(Name="Simple Construction", Layers=[sd_layer, sd_layer_2, sd_layer_3])  # -> Construction, UValue
sd_fenestration = SimpleDragonFenestrationConstruction(Name="Simple Window", UValue=1.5, SHGC=0.5)  # -> Construction, Transparent
packaged_office_profile = Panel("소규모사무실")
sd_profile = LookupSimpleDragonUsageProfile(Name=packaged_office_profile)  # -> Profile, AvailableNames, Diagnostics
sd_heat_pump = SimpleDragonHeatPump(Name="Heat Pump", Fuel="Electricity", HeatingCOP=3, CoolingCOP=3)  # -> Source, Diagnostics
sd_ahu = SimpleDragonAirHandlingUnit(Name="Air Handling Unit", Source=sd_heat_pump.Source)  # -> Supply, Diagnostics
sd_boiler = SimpleDragonBoiler(Name="Boiler", Fuel="NaturalGas", Efficiency=0.85, HotWaterSupply=False)  # -> Source, Diagnostics
sd_radiator = SimpleDragonRadiator(Name="Radiator", Source=sd_boiler.Source)  # -> Supply, Diagnostics
sd_chiller = SimpleDragonChiller(Name="Chiller", CoolingCOP=3, Compressor="Turbo", TowerCircuit="Open", TowerControl="SingleSpeed")  # -> Source, Diagnostics
sd_fan_coil = SimpleDragonFanCoilUnit(Name="Fan Coil Unit", Source=sd_chiller.Source)  # -> Supply, Diagnostics
sd_erv = SimpleDragonEnergyRecoveryVentilator(Name="Energy Recovery Ventilator", Airflow=0.2, HeatingEfficiency=0.7, CoolingEfficiency=0.45, Count=1)  # -> ZoneERV, Diagnostics
sd_pv = SimpleDragonPhotovoltaicPanel(Name="Photovoltaic Panel", Area=10, Efficiency=0.2, Azimuth=180, Tilt=30)  # -> PV, Diagnostics
envelope_u_value = Panel(sd_construction.UValue)
resolved_profile = Panel(sd_profile.Profile)
hvac_families = Panel([sd_ahu.Supply, sd_radiator.Supply, sd_fan_coil.Supply])
