# Grasshopper definition 12-simpledragon-two-zone-to-idf.gh (Grasshopper 1.0.7)
# plug-ins: SimpleDragon

window_zone_01_south = Curve(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)
window_zone_02_south = Curve(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)
zone_01_west = Brep(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)
zone_02_east = Brep(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)
# Rhino source model: Open 30-two-zone-office.3dm; relink each named Brep and window to its matching local Zone cluster.
packaged_office_profile = Panel("소규모사무실")
sd_profile = LookupSimpleDragonUsageProfile(Name=packaged_office_profile)  # -> Profile, AvailableNames, Diagnostics
sd_material = SimpleDragonMaterial(Name="Simple Material", Conductivity=0.04, Density=30, SpecificHeat=1400)
envelope_0_200_m = Slider(0.2, range=0.01..0.5)
sd_layer = SimpleDragonConstructionLayer(Material=sd_material, Thickness=envelope_0_200_m)
sd_construction = SimpleDragonSurfaceConstruction(Name="Simple Construction", Layers=sd_layer)  # -> Construction, UValue
sd_fenestration = SimpleDragonFenestrationConstruction(Name="Simple Window", UValue=1.5, SHGC=0.5)  # -> Construction, Transparent
sd_opening = SimpleDragonOpening(Boundary=window_zone_01_south, Name="Opening", Type=0, Construction=sd_fenestration.Construction, Blind="None")  # -> Opening, Diagnostics
sd_opening_2 = SimpleDragonOpening(Boundary=window_zone_02_south, Name="Opening", Type=0, Construction=sd_fenestration.Construction, Blind="None")  # -> Opening, Diagnostics
sd_heat_pump = SimpleDragonHeatPump(Name="Heat Pump", Fuel=0, HeatingCOP=3, CoolingCOP=3)  # -> Source, Diagnostics
sd_boiler = SimpleDragonBoiler(Name="Boiler", Fuel=1, Efficiency=0.85, HotWaterSupply=False)  # -> Source, Diagnostics
sd_pv = SimpleDragonPhotovoltaicPanel(Name="Photovoltaic Panel", Area=10, Efficiency=0.2, Azimuth=180, Tilt=30)  # -> PV, Diagnostics
west_zone_hvac = Panel("West Zone HVAC")
sd_ahu = SimpleDragonAirHandlingUnit(Name=west_zone_hvac, Source=sd_heat_pump.Source)  # -> Supply, Diagnostics
east_zone_hvac = Panel("East Zone HVAC")
sd_radiator = SimpleDragonRadiator(Name=east_zone_hvac, Source=sd_boiler.Source)  # -> Supply, Diagnostics
west_zone_erv = Panel("West Zone ERV")
sd_erv = SimpleDragonEnergyRecoveryVentilator(Name=west_zone_erv, Airflow=0.2, HeatingEfficiency=0.7, CoolingEfficiency=0.45, Count=1)  # -> ZoneERV, Diagnostics
east_zone_erv = Panel("East Zone ERV")
sd_erv_2 = SimpleDragonEnergyRecoveryVentilator(Name=east_zone_erv, Airflow=0.2, HeatingEfficiency=0.7, CoolingEfficiency=0.45, Count=1)  # -> ZoneERV, Diagnostics
sd_zone = SimpleDragonZone(
    ZoneBrep=zone_01_west,
    Name="Zone",
    FloorNumber=0,
    Profile=sd_profile.Profile,
    SurfaceConstruction=sd_construction.Construction,
    Openings=sd_opening.Opening,
    HVAC=sd_ahu.Supply,
    ERVs=sd_erv.ZoneERV,
    FloorBoundary="Ground",
    LightingPowerDensity=10)  # -> Zone, Diagnostics
sd_zone_2 = SimpleDragonZone(
    ZoneBrep=zone_02_east,
    Name="Zone",
    FloorNumber=0,
    Profile=sd_profile.Profile,
    SurfaceConstruction=sd_construction.Construction,
    Openings=sd_opening_2.Opening,
    HVAC=sd_radiator.Supply,
    ERVs=sd_erv_2.ZoneERV,
    FloorBoundary="Ground",
    LightingPowerDensity=10)  # -> Zone, Diagnostics
model_name = Panel("Two-Zone Office")
sd_model = SimpleDragonModel(
    Name=model_name,
    Zones=[sd_zone.Zone, sd_zone_2.Zone],
    NorthAxis=0,
    Address="서울특별시 종로구",
    Vintage="2020-01-01",
    MultifamilyHousing=False,
    PhotovoltaicPanels=sd_pv.PV)  # -> GRM, Zones, Surfaces, GeometryMap, GeometryMapData, JSON, FloorArea, Diagnostics
sd_to_idf = PrepareSimpleDragonSimulation(GRM=sd_model.GRM)  # -> EnergyModel, IDF, Weather, Success, Diagnostics
geometry_provenance_map = Panel(sd_model.GeometryMap)
total_floor_area = Panel(sd_model.FloorArea)
prepared_idf = Panel(sd_to_idf.IDF)
verified_packaged_weather = Panel(sd_to_idf.Weather)
preparation_success = Panel(sd_to_idf.Success)
