# Grasshopper definition 13-simpledragon-results-and-plots.gh (Grasshopper 1.0.7)
# plug-ins: SimpleDragon

# ---- group: 1 Result source
# Read the bundled GRR fixture once, then fan the typed result
# out to parallel consumers.
grr_fixture_path = FilePath("..\fixtures\simple-dragon\grr\ASHRAE 140 modified.grr")
read_grr = ReadSimpleDragonGRR(Path=grr_fixture_path)  # -> GRR, CanonicalJSON, Success, Diagnostics

# ---- group: 4 Optional CSV export
# CSV export writes only when explicitly triggered; this example
# previews the target package.
preview_export_directory = Panel("..\temp\example-preview\simpledragon-csv")
export_csv = ExportSimpleDragonCSV(GRR=read_grr.GRR, Directory=preview_export_directory, Export=False, Overwrite=False)  # -> FullDirectory, FileNames, FilePaths, Content, Written
csv_preview_files = Panel(export_csv.FileNames)

# ---- group: 2 Numeric summaries
# Summary and data-tree components expose annual and monthly
# numeric results.
grr_summary = SimpleDragonGRRSummary(GRR=read_grr.GRR, Metric="SiteUses", Gross=False)  # -> TotalArea, AnnualTotal, MonthlyTotals, Carriers, CarrierTotals, EndUses, EndUseTotals, Basis
grr_tree = SimpleDragonGRRDataTree(GRR=read_grr.GRR, Metric="SiteUses", Gross=False, Grouping="Fuel")  # -> SeriesNames, MonthNames, XValues, YValues, Unit, CSV
annual_site_use = Panel(grr_summary.AnnualTotal)
monthly_data_tree = Panel(grr_tree.YValues)

# ---- group: 3 Preview graphs
# Line and bar components create preview geometry from the same
# result object.
monthly_lines = SimpleDragonMonthlyLinePlot(GRR=read_grr.GRR, Metric="SiteUses", Gross=False, Grouping="Fuel", Plane=PlaneXY(0, 0, 0), Width=12, Height=6)  # -> Lines, Frame, ZeroAxis, SeriesNames, MonthNames, XValues, YValues, Unit
monthly_bars = SimpleDragonMonthlyBarPlot(
    GRR=read_grr.GRR,
    Metric="SiteUses",
    Gross=False,
    Grouping="Fuel",
    Plane=PlaneXY(0, 0, 0),
    Width=12,
    Height=6,
    Stacked=False)  # -> Bars, Frame, ZeroAxis, SeriesNames, MonthNames, XValues, YValues, Unit
line_plot_curves = Panel(monthly_lines.Lines)
bar_plot_curves = Panel(monthly_bars.Bars)
